# Grasshopper definition DrawALine.gh (Grasshopper 1.0.7)
# plug-ins: Rhino.Inside for Autodesk Revit

pt = ConstructPoint(XCoordinate="100", YCoordinate="100", ZCoordinate="100")
pt_2 = ConstructPoint(XCoordinate="0", YCoordinate="0", ZCoordinate="0")
ln = Line(StartPoint=pt_2, EndPoint=pt)
crv = Curve(ln)
crvdshape = AddCurveDirectShape(Curve=crv)
